# Grasshopper definition bike_rack_biomorpher.gh (Grasshopper 1.0.8)
# plug-ins: Pufferfish, Monolith, Biomorpher, Weaverbird, Kiwi3d, Kangaroo2 Components, DendroGH

# ---- group: rotate so that base is face down
angle_degree = Slider(0, range=0..360)
yz_plane = YZPlane(Origin=Point(0, 0, 0))

# ---- group: select components that must be retained in full form
brep = Brep()
mesh_brep = MeshBrep(
    Brep=brep,
    Settings={GridMaxCount=0, GridMinCount=16, JaggedSeams=False, MaxEdgeLength=0, MinEdgeLength=0.0001, MinTolerance=0, Refine=True, RefineAngle=0, RelativeTolerance=0.65, SimplePlanes=True, Tolerance=0})
mesh = Mesh(<mesh referenced from the Rhino model>)

# ---- group: spacing
panel = Panel("{200,0,0}")

# ---- group: point allocation and distribution
distance_for_point_averaging_mm = Slider(21, range=15..30)
num_points = Slider(1500, range=0..10000)
seed = Slider(2, range=0..10)
num_neighbors = Slider(6, range=2..8)

# ---- group: choose either a mesh or brep container
brep_2 = Brep(<brep referenced from the Rhino model>)
mesh_brep_2 = MeshBrep(
    Brep=brep_2,
    Settings={GridMaxCount=0, GridMinCount=16, JaggedSeams=False, MaxEdgeLength=0, MinEdgeLength=0.0001, MinTolerance=0, Refine=True, RefineAngle=0, RelativeTolerance=0.65, SimplePlanes=True, Tolerance=0})
mesh_2 = Mesh(<mesh referenced from the Rhino model>)

# ---- group: manufacturing parameters
max_node_width_mm = Slider(3.5, range=2..20)
max_print_angle_deg = Slider(65, range=0..100)
min_node_width_mm = Slider(3.5, range=2..10)
max_bridge_mm = Slider(6, range=0..10)
strut_size_mm = Slider(0.6, range=0..1)

# ----
mesh_3 = Mesh(<mesh referenced from the Rhino model>)
mesh_4 = Mesh([<mesh referenced from the Rhino model> x6])

# ---- group: components that must be removed
curve = Curve(<curve referenced from the Rhino model>)
mesh_5 = Mesh(flatten([mesh_4, mesh_3]))

# ----
move = Move(Geometry=mesh_2, Motion=panel)  # -> Geometry, Transform
radians = Radians(Degrees=angle_degree)
rotate = Rotate(Geometry=move.Geometry, Angle=radians, Plane=yz_plane)  # -> Geometry, Transform
boolean_toggle = BooleanToggle(True)
addition = Addition(A="1", B=Slider(0.01, range=0.01..0.05))
colour_swatch = ColourSwatch(SwatchColor=RGB(23, 114, 232))
create_material = CreateMaterial(Diffuse=colour_swatch, Specular=RGB(255, 255, 255), Emission=colour_swatch, Transparency=0, Shine=0)
colour_swatch_2 = ColourSwatch(SwatchColor=RGB(168, 157, 157))  # disabled
number_slider = Slider(0.5, range=0..1)  # disabled
curverefinement = CurveRefinement(PDeg=3, ElementRefU=5, IsKnotApproxElementSize=False, IsKnotSubdivision=True)  # disabled
material = Material(Name="Steel", Type="LIN_ELAST_ISOTROPIC", YoungsModulus=200000, AlphaT=0, Nue=0, Density=7.85, Strength=235000)  # disabled
pipe_section = PipeSection(DiameterOuter=0.2, DiameterInner=0)  # -> Section, Area; disabled
number_slider_2 = Slider(2, range=0..10)  # disabled
number_slider_3 = Slider(0.1, range=0..0.1)  # disabled
boolean_toggle_2 = BooleanToggle(True)  # disabled
range = Range(Domain=Domain(0, 1), Steps=number_slider_2)  # disabled
value_list = ValueList({"Displacements": 1, "Stresses": 2, "SupportForces": 3}, selected="Stresses")  # disabled
linear_analysis = LinearAnalysis(Name="MyAnalysis", OutputSetting=value_list)  # disabled
boolean_toggle_3 = BooleanToggle(True)  # disabled
value_list_2 = ValueList({"N": 1, "M1": 2, "M2": 3, "Mt": 4, "V1": 5, "V2": 6, "N stress": 7, "Shear stress 1": 8, "Shear stress 2": 9, "v Mises stress": 10, "Utilization (v Mises)": 11, "Cross Section": 12}, selected="v Mises stress")  # disabled
number_slider_4 = Slider(0.001, range=0..0.001)  # disabled
number_slider_5 = Slider(0.26, range=-1..1)  # disabled
number_slider_6 = Slider(0.26, range=-1..1)  # disabled
number_slider_7 = Slider(80, range=0..100)  # disabled
number_slider_8 = Slider(2.527, range=0..10)  # disabled
number_slider_9 = Slider(2.527, range=0..10)  # disabled
number_slider_10 = Slider(0.1, range=0.1..1)  # disabled
number_slider_11 = Slider(0.104, range=0..1)  # disabled
number_slider_12 = Slider(1000000, range=0..1000000)  # disabled
mesh_6 = Mesh(mesh_5)  # disabled
move_2 = Move(Geometry=mesh_6, Motion=panel)  # -> Geometry, Transform; disabled
number_slider_13 = Slider(0.5, range=0..1)  # disabled
panel_2 = Panel("{1,-4,-1}")  # disabled
move_3 = Move(Geometry=move_2.Geometry, Motion=panel)  # -> Geometry, Transform; disabled
create_settings = CreateSettings(VoxelSize=number_slider_13, Bandwidth=1, Isovalue=0, Adaptivity=0.1)  # disabled
number_slider_14 = Slider(1, range=0..1)  # disabled
number_slider_15 = Slider(0, range=0..100)  # disabled
mesh_to_volume = MeshToVolume(Mesh=move_3.Geometry, Settings=create_settings)  # -> flatten(Volume); disabled
number_slider_16 = Slider(15, range=0..100)  # disabled
number_slider_17 = Slider(2, range=0..10)  # disabled
move_4 = Move(Geometry=mesh_4, Motion=panel)  # -> Geometry, Transform; disabled
number_slider_18 = Slider(10, range=0..10)  # disabled
number_slider_19 = Slider(50, range=0..100)  # disabled
move_5 = Move(Geometry=move_4.Geometry, Motion=panel)  # -> Geometry, Transform; disabled
boolean_toggle_4 = BooleanToggle(True)  # disabled
panel_3 = Panel("wellness score")  # disabled
panel_4 = Panel("form score")  # disabled
square = Square(Plane=PlaneXY(0, 0, 0), Size=number_slider_19, ExtentX=number_slider_18, ExtentY=number_slider_18)  # -> Cells, flatten(Points); disabled
merge = Merge(Data1=panel_3, Data2=panel_4)  # disabled
list_length = ListLength()  # disabled
text = Text(merge)  # disabled
construct_point = ConstructPoint(XCoordinate=0, YCoordinate=0, ZCoordinate=0)  # disabled
split_list = SplitList(List=square.Points, Index=list_length)  # -> ListA, ListB; disabled
move_6 = Move(Geometry=move_5.Geometry, Motion=panel)  # -> Geometry, Transform; disabled
colour_swatch_3 = ColourSwatch(SwatchColor=RGB(184, 184, 184))  # disabled
vector_2pt = Vector2Pt(PointA=construct_point, PointB=split_list.ListA, Unitize=False)  # -> Vector, Length; disabled
custom_preview = CustomPreview(Geometry=move_6.Geometry, Material=colour_swatch_3)  # disabled
move_7 = Move(Motion=vector_2pt.Vector)  # -> Geometry, Transform; disabled

# ---- group: fill with random points, cluster and draw lines
populate_geometry = PopulateGeometry(Geometry=rotate.Geometry, Count=num_points, Seed=seed)
point = Point(populate_geometry)
flatten_tree = FlattenTree(Tree=point, Path="{0}")
graft_tree = GraftTree(Tree=flatten_tree, IncludeEmptyLists=True, IncludeNullItems=True)

# ----
closest_points = ClosestPoints(Point=graft_tree, Cloud=point, Count=num_neighbors)  # -> ClosestPoint, CPIndex, Distance

# ---- group: fill with random points, cluster and draw lines (continued)
line = Line(StartPoint=closest_points.ClosestPoint, EndPoint=graft_tree)
clean_tree = CleanTree(RemoveNulls=True, RemoveInvalid=True, RemoveEmpty=False, Tree=line)
flatten_tree_2 = FlattenTree(Tree=clean_tree, Path="{0}")

# ---- group: find average points within tolerance
discontinuity = Discontinuity(Curve=flatten_tree_2, Level=1)  # -> simplify(Points), Parameters
cull_duplicates = CullDuplicates(Points=flatten(discontinuity.Points), Tolerance=distance_for_point_averaging_mm, CullMode=3)  # -> simplify(Points), Indices, Valence
closest_point = ClosestPoint(Point=discontinuity.Points, Cloud=cull_duplicates.Points)  # -> simplify(ClosestPoint), CPIndex, Distance

# ----
point_2 = Point(closest_point.ClosestPoint)

# ---- group: remove zero length lines
list_item = ListItem(List=point_2, Index=0, Wrap=True)  # -> Item, Item1
distance = Distance(PointA=list_item.Item, PointB=list_item.Item1)
cull_pattern = CullPattern(List=point_2, CullPattern=distance)
clean_tree_2 = CleanTree(RemoveNulls=True, RemoveInvalid=True, RemoveEmpty=True, Tree=cull_pattern)

# ---- group: create lines and remove dupls
list_item_2 = ListItem(List=clean_tree_2, Index=0, Wrap=True)  # -> Item, Item1
line_2 = Line(StartPoint=list_item_2.Item, EndPoint=list_item_2.Item1)  # -> flatten(Line)
removeduplicatelines = RemoveDuplicateLines(Lines=line_2, Tolerance=0.01)

# ---- group: remove lines outside print angle max
unit_z = UnitZ(Factor=1)  # disabled
plane_surface = PlaneSurface(Plane=removeduplicatelines, XSize=Domain(-10, 10), YSize=Domain(-10, 10))  # disabled
number_slider_20 = Slider(180, range=0..1000)  # disabled
number_slider_21 = Slider(0, range=0..1000)  # disabled
angle = Angle(VectorA=plane_surface, VectorB=unit_z)  # -> Angle, Reflex; disabled
degrees = Degrees(Radians=angle.Angle)  # disabled
subtraction = Subtraction(A=number_slider_20, B=max_print_angle_deg)  # disabled
addition_2 = Addition(A=number_slider_21, B=max_print_angle_deg)  # disabled
smaller_than = SmallerThan(FirstNumber=degrees, SecondNumber=subtraction)  # -> SmallerThan, OrEqualTo; disabled
larger_than = LargerThan(FirstNumber=degrees, SecondNumber=addition_2)  # -> LargerThan, OrEqualTo; disabled
gate_and = GateAnd(A=smaller_than.SmallerThan, B=larger_than.LargerThan)  # disabled
invert_boolean = InvertBoolean(Boolean=gate_and)  # -> Inverted, Number; disabled

# ---- group: leave lines if they are on the bottom of the model
discontinuity_2 = Discontinuity(Curve=removeduplicatelines, Level=1)  # -> Points, Parameters; disabled
number_slider_22 = Slider(7, range=0..10)  # disabled
deconstruct = Deconstruct(Point=discontinuity_2.Points)  # -> XComponent, YComponent, ZComponent; disabled
addition_3 = Addition(B=number_slider_22)  # disabled
smaller_than_2 = SmallerThan(FirstNumber=deconstruct.ZComponent, SecondNumber=addition_3)  # -> SmallerThan, OrEqualTo; disabled
number_slider_23 = Slider(2, range=0..100)  # disabled
mass_addition = MassAddition(Input=smaller_than_2.SmallerThan)  # -> flatten(Result), PartialResults; disabled
equality = Equality(FirstNumber=mass_addition.Result, SecondNumber=number_slider_23)  # -> Equality, Inequality; disabled

# ---- group: if lines are close enough to the node to bridge than keep
number_slider_24 = Slider(10, range=0..10)  # disabled
length = Length(Curve=removeduplicatelines)  # disabled
multiplication = Multiplication(A=max_node_width_mm, B=number_slider_24)  # disabled
subtraction_2 = Subtraction(A=length, B=multiplication)  # disabled
smaller_than_3 = SmallerThan(FirstNumber=subtraction_2, SecondNumber=max_bridge_mm)  # -> SmallerThan, OrEqualTo; disabled

# ----
gate_or = GateOr(A=invert_boolean.Inverted, C=equality.Equality, B=smaller_than_3.SmallerThan)  # disabled
cull_pattern_2 = CullPattern(List=removeduplicatelines, CullPattern=gate_or)  # disabled
curve_2 = Curve(removeduplicatelines)
entwine = Entwine(Branch00=curve_2, FlattenInputs=True)

# ---- group: reparameteratize so that lower nodes are thicker than higher nodes
end_points = EndPoints(Curve=curve_2)  # -> Start, End
point_3 = Point(end_points.End)
deconstruct_2 = Deconstruct(Point=point_3)  # -> XComponent, YComponent, ZComponent
construct_domain = ConstructDomain(DomainStart=max_node_width_mm, DomainEnd=min_node_width_mm)
bounds = Bounds(Numbers=deconstruct_2.ZComponent)
remap_numbers = RemapNumbers(Value=deconstruct_2.ZComponent, Source=bounds, Target=construct_domain)  # -> Mapped, Clipped

# ----
entwine_2 = Entwine(Branch00=point_3, FlattenInputs=True)
entwine_3 = Entwine(Branch00=remap_numbers.Mapped, FlattenInputs=True)

# ---- group: create multipipe
multipipe = MultiPipe(
    Curves=entwine,
    NodeSize=entwine_3,
    SizePoints=entwine_2,
    EndOffset=1,
    StrutSize=strut_size_mm,
    Segment=0,
    KinkAngle=0.6,
    CubeFit=Slider(1, range=0..1),
    Caps=Slider(1, range=0..1))  # -> flatten(Pipe)

# ----
move_8 = Move(Geometry=multipipe, Motion="{0,-6,-6}")  # -> Geometry, Transform
mesh_join = MeshJoin(Meshes=move_8.Geometry)  # -> flatten(Mesh)

# ---- group: clean and examine mesh
weaverbird_s_join_meshes_and_weld = WeaverbirdsJoinMeshesAndWeld(Mesh=mesh_join, Weld=Toggle(True))
clean_tree_3 = CleanTree(RemoveNulls=True, RemoveInvalid=True, RemoveEmpty=False, Tree=weaverbird_s_join_meshes_and_weld)
weaverbird_s_catmull_clark_subdivision = WeaverbirdsCatmullClarkSubdivision(MeshCurves=clean_tree_3, Level=Slider(3, range=0..10), SmoothNakedEdges=Toggle(True))

# ----
point_4 = Point(point_3)
move_9 = Move(Geometry=weaverbird_s_catmull_clark_subdivision, Motion=panel)  # -> Geometry, Transform
deconstruct_3 = Deconstruct(Point=point_4)  # -> XComponent, YComponent, ZComponent
list_length_2 = ListLength(List=deconstruct_3.YComponent)
sort_list = SortList(Keys=deconstruct_3.YComponent, ValuesValuesA=deconstruct_3.YComponent)  # -> Keys, ValuesValuesA
subtraction_3 = Subtraction(A=list_length_2, B="0")
list_item_3 = ListItem(List=sort_list.ValuesValuesA, Index=subtraction_3, Wrap=True)
custom_preview_2 = CustomPreview(Geometry=move_9.Geometry, Material=create_material)
addition_4 = Addition(A=list_item_3, B=Slider(6, range=0..10))
smaller_than_4 = SmallerThan(FirstNumber=deconstruct_3.YComponent, SecondNumber=addition_4)  # -> SmallerThan, OrEqualTo
cull_pattern_3 = CullPattern(List=point_4, CullPattern=smaller_than_4.SmallerThan)
move_10 = Move(Geometry=weaverbird_s_catmull_clark_subdivision, Motion=panel)  # -> Geometry, Transform; disabled
custom_preview_3 = CustomPreview(Geometry=move_10.Geometry, Material=colour_swatch_2)  # disabled
beams = Curve(curve_2)  # disabled
point_5 = Point(cull_pattern_3)  # disabled
beam_element = BeamElement(
    Curve=beams,
    Material=material,
    Section=pipe_section.Section,
    CurveRefinement=curverefinement,
    HingeStart=False,
    HingeEnd=False,
    HingeBtw=False)  # disabled
supportpoint = SupportPoint(
    Point=point_5,
    DispX=True,
    DispY=True,
    DispZ=True,
    Rotation=boolean_toggle_2,
    Torsion=boolean_toggle_2,
    TryStrongSupport=True)  # disabled
curve_load = CurveLoad(Crv=beams, Loadtype="DEAD", Direction=Vector(0, 0, -1), Value=number_slider_3, LoadCase=1)  # disabled
parameter_pipe_mesh = ParameterPipeMesh(
    Curve=beams,
    Radius=number_slider,
    ParametersU=range,
    ParametersV=[0, 0.25, 0.5, 0.75, 1],
    Weighted=False,
    Lengths=False,
    Angle=0,
    Rotation=0,
    EndType=0,
    Triangulate=False)  # disabled
deconstruct_mesh = DeconstructMesh(Mesh=parameter_pipe_mesh)  # -> Vertices, Faces, Colours, Normals; disabled
analysismodel = AnalysisModel(
    Analysis=linear_analysis,
    StructuralElements=beam_element,
    Supports=supportpoint,
    Loads=curve_load,
    IntersectionTolerance=0.01,
    IsCarat=True,
    IsKratos=False,
    PenaltyFac=10000000,
    ShowCouplingIDs=False,
    ShowEdgeIDs=False,
    ShowGeo=True,
    ShowPatchIDs=True,
    ShowPrePro=True,
    ShowRef=False,
    mUsedVersion="BETA 0.6.0")  # disabled
analysis_completed = IGASolver(AnalysisModel=analysismodel, Run=boolean_toggle_3, antiFreeze=False, showWindow=True)  # -> ResultModel, ErrorReport; disabled
_1d_element_result_view = _1DElementResultView(Model=analysis_completed.ResultModel, Type=value_list_2, ScaleFactor=number_slider_4, ShowColourPlot=True)  # -> Results, ResultList, Mesh, LegendC, LegendT; disabled
mesh_7 = Mesh(move_10.Geometry)  # disabled
number = Number(_1d_element_result_view.Results)  # disabled
absolute = Absolute(Value=number)  # disabled
construct_geometric_source = ConstructGeometricSource(Geom=mesh_7, Strength=number_slider_5, Decay=number_slider_8, Type=2)  # disabled
average = Average(Input=absolute)  # disabled
sort_list_2 = SortList(Keys=absolute)  # -> reverse(Keys), ValuesValuesA; disabled
list_item_4 = ListItem(List=sort_list_2.Keys, Index=0, Wrap=True)  # disabled
multiplication_2 = Multiplication(A=average, B=number_slider_10)  # disabled
multiplication_3 = Multiplication(A=multiplication_2, B=list_item_4)  # disabled
division = Division(A=multiplication_3, B=number_slider_12)  # disabled
flatten_tree_3 = FlattenTree(Tree=division, Path="{0}")  # disabled
number_2 = Number(flatten_tree_3)  # disabled
curve_3 = Curve(beams)  # disabled
sort_list_3 = SortList(Keys=number_2)  # -> reverse(Keys), ValuesValuesA; disabled
bounding_box = BoundingBox(Content=curve_3, Plane=PlaneXY(0, 0, 0), UnionBox=True)  # -> Box, Box_2; disabled
list_item_5 = ListItem(List=sort_list_3.Keys, Index=0, Wrap=True)  # disabled
gradient = Gradient(
    LowerLimit=0,
    UpperLimit=list_item_5,
    Parameter=number_2,
    stops=[0: RGB(0, 128, 0), 0.12: RGB(255, 255, 0), 1: RGB(255, 0, 0)])  # disabled
mass_addition_2 = MassAddition(Input=simplify(flatten(division)))  # -> Result, PartialResults; disabled
evaluate_box = EvaluateBox(Box=bounding_box.Box, UParameter=number_slider_15, VParameter=number_slider_15, WParameter=number_slider_15)  # -> Plane, Point, Include; disabled
evaluate_box_2 = EvaluateBox(Box=bounding_box.Box, UParameter=number_slider_14, VParameter=number_slider_14, WParameter=number_slider_14)  # -> Plane, Point, Include; disabled
length_2 = Length(Curve=curve_3)  # disabled
mass_addition_3 = MassAddition(Input=length_2)  # -> Result, PartialResults; disabled
negative = Negative(Value=mass_addition_2.Result)  # disabled
distance_2 = Distance(PointA=evaluate_box.Point, PointB=evaluate_box_2.Point)  # disabled
graft_tree_2 = GraftTree(Tree=gradient, IncludeEmptyLists=True, IncludeNullItems=True)  # disabled
strength = Number(negative)  # disabled
number_3 = Number(mass_addition_3.Result)  # disabled
number_4 = Number(distance_2)  # disabled
mesh_8 = Mesh(weaverbird_s_catmull_clark_subdivision)  # disabled
multiplication_4 = Multiplication(A=number_4, B=number_slider_17)  # disabled
construct_mesh = ConstructMesh(Vertices=deconstruct_mesh.Vertices, Faces=deconstruct_mesh.Faces, Colours=graft_tree_2)  # disabled
multiplication_5 = Multiplication(A=number_3, B=multiplication_4)  # disabled
fitness = Number(multiplication_5)  # disabled
mesh_9 = Mesh(construct_mesh)  # disabled
entwine_4 = Entwine(Branch00=flatten(strength), Branch01=flatten(fitness), FlattenInputs=True)  # disabled
volume = Volume(Geometry=mesh_8)  # -> Volume, Centroid; disabled
clean_tree_4 = CleanTree(RemoveNulls=boolean_toggle_4, RemoveInvalid=boolean_toggle_4, RemoveEmpty=boolean_toggle_4, Tree=entwine_4)  # disabled
number_5 = Number(clean_tree_4)  # disabled
biomorpher = Biomorpher(
    Genome=[num_neighbors, distance_for_point_averaging_mm, max_node_width_mm, min_node_width_mm, strut_size_mm],
    Geometry=mesh_8,
    Performs=[fitness, strength, volume.Volume])  # disabled

# ---- group: add back original geometries without modification
radians_2 = Radians(Degrees=angle_degree)
move_11 = Move(Geometry=mesh, Motion=panel)  # -> Geometry, Transform
rotate_2 = Rotate(Geometry=move_11.Geometry, Angle=radians_2, Plane=yz_plane)  # -> Geometry, Transform
mesh_10 = Mesh(rotate_2.Geometry)

# ----
rebuild_mesh = RebuildMesh(
    Mesh=mesh_10,
    RebuildNormals=False,
    CullUnused=boolean_toggle,
    UnifyNormals=False,
    FlipNormals=False,
    IdenticalCombine=False,
    WeldVertices=boolean_toggle)
deconstruct_mesh_2 = DeconstructMesh(Mesh=rebuild_mesh)  # -> flatten(Vertices), flatten(Faces), Colours, Normals
point_6 = Point(deconstruct_mesh_2.Vertices)
deconstruct_4 = Deconstruct(Point=deconstruct_mesh_2.Vertices)  # -> XComponent, YComponent, ZComponent
sort_list_4 = SortList(Keys=deconstruct_4.YComponent, ValuesValuesA=deconstruct_4.YComponent)  # -> flatten(Keys), ValuesValuesA
list_length_3 = ListLength(List=deconstruct_4.YComponent)
subtraction_4 = Subtraction(A=list_length_3, B="1")
list_item_6 = ListItem(List=sort_list_4.Keys, Index=subtraction_4, Wrap=True)
multiplication_6 = Multiplication(A=list_item_6, B=addition)
larger_than_2 = LargerThan(FirstNumber=deconstruct_4.YComponent, SecondNumber=multiplication_6)  # -> LargerThan, OrEqualTo
cull_pattern_4 = CullPattern(List=point_6, CullPattern=[larger_than_2.LargerThan, larger_than_2.OrEqualTo])  # -> flatten(List)
patch = Patch(Points=cull_pattern_4, Spans=20, Flexibility=1, Trim=True)
simple_mesh = SimpleMesh(Brep=patch)
weaverbird_s_mesh_thicken = WeaverbirdsMeshThicken(MeshCurves=simple_mesh, Distance=Slider(3, range=0..10), OffsetType=0)
area = Area(Geometry=weaverbird_s_mesh_thicken)  # -> Area, Centroid
scale = Scale(Geometry=weaverbird_s_mesh_thicken, Center=area.Centroid, Factor=Slider(0.9, range=0..1))  # -> Geometry, Transform
mesh_11 = Mesh(mesh_10)

# ---- group: add back original geometries without modification (continued)
mesh_12 = Mesh(scale.Geometry)

# ----
move_12 = Move(Geometry=mesh_11, Motion=panel)  # -> Geometry, Transform
move_13 = Move(Geometry=mesh_12, Motion=panel)  # -> Geometry, Transform
mesh_join_2 = MeshJoin(Meshes=flatten([move_10.Geometry, move_12.Geometry]))
bounding_box_2 = BoundingBox(Content=mesh_join_2, Plane=PlaneXY(0, 0, 0))  # -> Box, Box_2
mesh_13 = Mesh(move_13.Geometry)  # disabled
brep_3 = Brep(bounding_box_2.Box)  # disabled
construct_geometric_source_2 = ConstructGeometricSource(Geom=mesh_13, Strength=number_slider_6, Decay=number_slider_9, Type=2)  # disabled
construct_base_voxels = ConstructBaseVoxels(Box=brep_3, Resolution=number_slider_7, BaseChannelTypes=2, Fill=0)  # disabled
add_sources = AddSources(
    Voxels=construct_base_voxels,
    Shape=flatten([construct_geometric_source_2, construct_geometric_source]),
    variables="Shape,MaterialRatio")  # disabled
get_channel_names = GetChannelNames(Voxels=add_sources, variables="Shape,MaterialRatio")  # -> Shape, MaterialRatio; disabled
get_iso_mesh = GetIsoMesh(Voxels=add_sources, Channel=get_channel_names.Shape, IsoValue=number_slider_11, CapEdgeFaces=True)  # disabled
move_14 = Move(Geometry=get_iso_mesh, Motion=panel_2)  # -> Geometry, Transform; disabled
mesh_to_volume_2 = MeshToVolume(Mesh=move_14.Geometry, Settings=create_settings)  # disabled
volume_difference = VolumeDifference(VolumeA=mesh_to_volume_2, VolumesB=mesh_to_volume)  # disabled
smooth_volume = SmoothVolume(Volume=volume_difference, Width=1, Type=2, Iterations=number_slider_16)  # disabled
volume_to_mesh = VolumeToMesh(Volume=smooth_volume, VolumeSettings=create_settings)  # disabled
mesh_join_3 = MeshJoin(Meshes=flatten([move_12.Geometry, volume_to_mesh]))  # disabled

# ---- group: visualize
move_15 = Move(Geometry=mesh_join_3, Motion=panel)  # -> Geometry, Transform; disabled
colour_swatch_4 = ColourSwatch(SwatchColor=RGB(23, 114, 232))  # disabled

# ----
create_material_2 = CreateMaterial(Diffuse=colour_swatch_4, Specular=RGB(255, 255, 255), Emission=colour_swatch_4, Transparency=0, Shine=0)  # disabled

# ---- group: visualize (continued)
custom_preview_4 = CustomPreview(Geometry=move_15.Geometry, Material=create_material_2)  # disabled
